# Grasshopper definition GrasshopperClippingP+Camera_Ref.gh (Grasshopper 1.0.7)
# plug-ins: horsterCameraControl

pt = ConstructPoint(
    XCoordinate=expr("x*10", Slider(193, range=-500..500)),
    YCoordinate=expr("x*10", Slider(-110, range=-500..500)),
    ZCoordinate=expr("x*10", Slider(30, range=-500..500)))
pt_2 = ConstructPoint(
    XCoordinate=expr("x*10", Slider(126, range=-500..500)),
    YCoordinate=expr("x*10", Slider(6, range=-500..500)),
    ZCoordinate=expr("x*10", Slider(30, range=-500..500)))
pt_3 = ConstructPoint(
    XCoordinate=expr("x*10", Slider(48, range=-500..500)),
    YCoordinate=expr("x*10", Slider(-27, range=-500..500)),
    ZCoordinate=expr("x*10", Slider(30, range=-500..500)))
pt_4 = ConstructPoint(
    XCoordinate=expr("x*10", Slider(234, range=-500..500)),
    YCoordinate=expr("x*10", Slider(13, range=-500..500)),
    ZCoordinate=expr("x*10", Slider(30, range=-500..500)))
id = Guid(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)
xz = XZPlane(Origin=pt)
id_2 = Guid(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)
xz_2 = XZPlane(Origin=pt_2)
id_3 = Guid(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)
id_4 = Guid(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)
xz_3 = XZPlane(Origin=pt_3)
xz_4 = XZPlane(Origin=pt_4)
rotate = Rotate(Geometry=xz, Angle=degrees(Slider(180, range=-180..180)), Plane=pt)  # -> Geometry, Transform
rotate_2 = Rotate(Geometry=xz_2, Angle=degrees(Slider(0, range=-180..180)), Plane=pt_2)  # -> Geometry, Transform
rotate_3 = Rotate(Geometry=xz_3, Angle=degrees(Slider(90, range=-180..180)), Plane=pt_3)  # -> Geometry, Transform
rotate_4 = Rotate(Geometry=xz_4, Angle=degrees(Slider(-90, range=-180..180)), Plane=pt_4)  # -> Geometry, Transform
c_script = CSharpScript(id=id, pl=rotate.Geometry)  # -> out; inputs id: Guid, pl: Plane
# ---------- c_script: C# ----------
    var cp = new Rhino.DocObjects.ObjRef(id);
    var source = cp.ClippingPlaneSurface().Plane;
    RhinoDoc.ActiveDoc.Objects.Transform(id, Transform.PlaneToPlane(source, pl), true);
# ---------- end c_script ----------
c_script_2 = CSharpScript(id=id_2, pl=rotate_2.Geometry)  # -> out; inputs id: Guid, pl: Plane; same code as c_script
c_script_3 = CSharpScript(id=id_3, pl=rotate_3.Geometry)  # -> out; inputs id: Guid, pl: Plane; same code as c_script
c_script_4 = CSharpScript(id=id_4, pl=rotate_4.Geometry)  # -> out; inputs id: Guid, pl: Plane; same code as c_script
rad = Radians(Degrees=Slider(238, range=0..360))
pt_5 = ConstructPoint(
    XCoordinate=expr("x*10", Slider(-30, range=-500..500)),
    YCoordinate=expr("x*10", Slider(-357, range=-500..500)),
    ZCoordinate=expr("x*10", Slider(411, range=0..500)))
toggle = BooleanToggle(False)  # disabled
pt_6 = ConstructPoint(
    XCoordinate=expr("x*10", Slider(137, range=0..500)),
    YCoordinate=Slider(0, range=0..500),
    ZCoordinate=Slider(500, range=0..500))
rotate_5 = Rotate(Geometry=pt_5, Angle=rad, Plane=pt_6)  # -> Geometry, Transform
setcam = SetCamera(CameraLocation=rotate_5.Geometry, TargetLocation=pt_6, LensLength=Slider(0, range=0..100), Activate=toggle)
